# Grasshopper definition LARGERslicer - Head (Ginger One, non-planar).gh (Grasshopper 1.0.9)
# plug-ins: LARGERslicer

# ---- group: 01. PART AND PRINT SETTINGS
# LARGER.slicer
# HEAD  -  GINGER ADDITIVE · GINGER ONE (MARLIN), NON-PLANAR SPIRAL THAT FOLLOWS THE SURFACE
# The head of the 2024 print 'UNIKAT HEAD V2', placed and sliced the way it was printed
# INSTRUCTIONS: INSTRUCTIONS
# 
# 1  'Head' is the head of the 2024 print 'UNIKAT HEAD V2' exactly as it was printed: the NurbsHead (Head.3dm), turned about 75 degrees, scaled about 1.74 / 1.56 / 1.83, cut flat at the neck, its bottom on Z 0, at X 242-380, Y 220-337 on the 1000 x 1000 mm bed. For your own part: replace 'Head' (in mm, standing on Z 0; a closed shell or an open one with a flat bottom ring).
# 
# 2  Print Settings: bead 4 mm, layer 1.75 mm, first layer 0.9 mm at 25 mm/s (F1500), 11.1 mm/s, Overlap 0 (the brim rings lie 4 mm apart), Min Speed 0.2 mm/s (the small rings of the crown slow down to 40 s), travel 166.7 mm/s (F10000).
# 
# 3  Slice, Guide Mode 3 'Follow the surface': rings on the head's surface from the neck to the crown, under chin and nose as well; the first two lie flat (Z 0.9 and 2.65), the last ones close the crown. Walls: one, centred on the surface. Continuous Path: Spiral, Min Layer Time 40 s, Max Volume Rate 330 mm3/s. The extrusion follows the law of the 2024 print: E = 0.21 x 4 x t x length, t = the vertical gap where the ring below lies underneath, less where it lies to the side.
# 
# 4  Start and End: no skirt, a brim of 7 beads around the foot (as in 2024), exit move.
# 
# 5  Read Path Check and Non-Planar Check: both OK. Move 'Pose' to see the printer head on the path.
# 
# 6  Click 'Save G-code' on Machine G-code (Ginger One, Marlin). The file goes to the Desktop (GIN_..._Head_...gcode).
# 
# Extrusion: E = 0.21 x bead width x bead height x length (Ginger handbook, PLA virgin, all nozzles). Other materials: Extrusion Factor on Machine. Check the factor with a test wall and Material Factor (05).
# Cooling: the Ginger start code runs the fan at 0 % on layers 1 to 4 and writes M106 S153 (60 %) after layer 4.
# 01. PART AND PRINT SETTINGS
# The head as printed in 2024 and its values: bead 4 mm, layer 1.75 mm, first layer 0.9 mm at 25 mm/s, 11 mm/s.
head = Brep(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)
printset = PrintSettings(
    BeadWidth=4,
    LayerHeight=1.75,
    Speed=11.1,
    Flow=1,
    Overlap=0,
    MinRadius=0,
    Resolution=1.8,
    FilamentDiameter=0,
    MinSpeed=0.2,
    MaxSpeed=166.666667,
    Preview=False,
    Density=1.25,
    FirstLayerHeight=0.9,
    Nozzle=0,
    FirstLayerSpeed=25,
    SpeedMmS=True)

# ---- group: 02. SLICE ALONG THE SURFACE, ONE SPIRAL
# 02. SLICE ALONG THE SURFACE, ONE SPIRAL
# Guide Mode 'Follow the surface': rings on the head's surface from the neck to the crown, the nozzle vertical. One wall centred on the surface, spiral, Min Layer Time 40 s, then a brim of 7 beads and the exit.
# NOTES: WHERE THE NUMBERS COME FROM
# 
# The reference: G-code 'UntitledUNIKAT HEAD V2' (Ginger One, Marlin, July 2024), printed well. Made by the definition 'BE GINGER SLICER (Non Planar Head) V1.1': brim of 8 rings (offsets 0.1 + 4 i mm of the foot), one flat ring at Z 2.0, then 120 laps = iso-curves of the head surface, smoothed and spiralized, E = 0.21 x 4 x t x length with the bead height t from the closest point of the lap below:
#   t = h (1 - (h/w)(1 - sin a)((w/h) - cos a)) = dz + (h - dz) x dxy / w
# (fits all 18 041 points of the file to 0.0006 E/mm), F = lap length / 40 s (35 s for the longest laps), first layer F1500.
# 
# 2024 print (V2)  -  this example (Follow the surface)
#   laps (turns > 30 mm): 119 - 123
#   Z of the beads: 0.9 to 178.0 - 0.9 to 177.4 mm
#   bed area: X 241.8-379.1, Y 200.0-340.2 - X 241.6-379.5, Y 199.8-340.3
#   Z span within one lap, median / max: 10.9 / 18.7 - 8.4 / 11.9 mm
#   E/mm on the head 5 % / median / 95 %: 0.94 / 1.42 / 1.57 - 0.92 / 1.35 / 1.69
#   E total: 48353 - 48621
#   F per lap: 46 to 665 - 69 to 588 mm/min (Min Layer Time 40 s for every lap)
#   first layer: Z 0.9, F1500, 2627 mm, E/mm 0.756 - Z 0.9, F1500, 2628 mm, E/mm 0.756
#   crown: rings 1.8 mm apart down to r 1.5, E/mm 0.8 - 1.5 to 2 mm apart down to r 2.7, E/mm 0.5 to 0.7
#   time: 81 - 87 min
# 
# The one small overlap of 2024 (where the brim runs into the head): the brim rings ended at one place and the straight links between them lay side by side, 2.9 mm apart (28 % of the bead overlapping), the last one under the head's foot. Here the links form a staircase (each ring ends half a bead further on), the foot ring stops one bead before its start as in 2024, and the first climbing lap rises from nothing over that gap: 18 mm2 of the first layer are covered twice instead of 121 mm2.
# 
# Checks: under the chin and on the crown the rings lean on the ring below. Path Check accepts up to one bead width beside the lap below at up to 2.5 % of the points, Non-Planar Check bead heights up to 1.1 x bead width at 0.5 % and below 0.4 x layer height at 1 % of the points, and grazes of the nozzle up to 0.6 mm - all measured on the 2024 print, which printed fine with 1.8 %, 0.3 % / 0.1 % and 0.5 mm.
slice = Slice(
    Geometry=head,
    Settings=printset,
    Plane=PlaneXY(0, 0, 0),
    Angle=0,
    GuideMode=3,
    ToolAxis=1,
    StartEndLayers=0,
    LARGER_Background=True)  # -> Layers, Contours, Info
walls = Walls(Layers=slice.Layers, Settings=printset, Count=1, Position=1)  # -> Layers, Contours, Info
contpath = ContinuousPath(
    Layers=walls.Layers,
    Settings=printset,
    Mode=0,
    SeamGap=0,
    Bridge=True,
    SeamMode=0,
    MinLayerTime=40,
    MaxVolumeRate=330,
    ShortLapTime=0,
    LARGER_Background=True)  # -> Toolpath, Info
startend = StartAndEnd(Toolpath=contpath.Toolpath, SkirtLoops=0, SkirtDistance=0, ExitLength=50, ExitLift=20, ExitFlow=0, Brim=1, BrimLoops=7)  # -> Toolpath, Info

# ---- group: 03. CHECKS
# 03. CHECKS
# Path Check: support, crossings, layer time. Non-Planar Check: bead heights and the head. Move Pose.
check = PathCheck(Toolpath=startend.Toolpath, MaxOffset=0, MinLayerTime=0)  # -> OK, Report, Unsupported, Offset, Crossings, LayerTimes
path_check = Panel(check.Report)
pose_0_start_1_end = Slider(0.2, range=0..1)
np_check = NonPlanarCheck(
    Toolpath=startend.Toolpath,
    TipRadius=4,
    ConeAngle=30,
    ConeLength=60,
    HeadRadius=40,
    Pose=pose_0_start_1_end,
    LARGER_Background=True)  # -> OK, Report, BeadHeight, BadHeights, Collisions, Head
non_planar_check = Panel(np_check.Report)

# ---- group: 05. CALIBRATION
# 05. CALIBRATION
# Print a test wall, measure the bead width, enter it here. Use New Factor as Extrusion Factor on Machine.
factor = MaterialFactor(TargetWidth=4, CurrentFactor=0.21)  # -> NewFactor, Report, Off, Mean

# ---- group: 04. G-CODE FOR THE GINGER ONE
# 04. G-CODE FOR THE GINGER ONE
# Machine 0: Ginger Additive · Ginger One (Marlin). Click 'Save G-code'.
machine = Machine(Machine=0, Save=False, Kind=0)  # -> Machine, Definition, Info, Model
part_name = Panel("Head")
g_code = MachineGCode(Toolpath=startend.Toolpath, Machine=machine.Machine, Name=part_name, Save=False)  # -> GCode, Info, FileName, Model, Simulation
simulate = PrinterSimulation(Toolpath=g_code.Simulation, Pose=1, Play=False, FilmLength=20, CheckCollisions=True)  # -> Model, Printed, Tip, Info, Seconds, Colliding, Collisions
simulation = Panel(simulate.Info)
