# Grasshopper definition Bottom line Tests.gh (Grasshopper 1.0.8)
# plug-ins: LARGERslicer

number_slider = Slider(0, range=0..10)
number_slider_2 = Slider(83, range=0..100)
number_slider_3 = Slider(3.5, range=0.1..10)
number_slider_4 = Slider(5, range=0..10)
curve = Curve(<curve referenced from the Rhino model>)
point = Point(Point(94.67248245, -469.3917618, 0))
curve_2 = Curve(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)
continuous_toolpath = ContinuousToolpath(
    Curve=curve,
    LineSpacing=2,
    BoundaryOffset=0,
    RandomBridges=False,
    BridgeDensity=0.3,
    HandleUndercuts=True,
    UseArcWelder=False,
    ArcTolerance=Slider(0.01, range=0..0.01))  # -> Path, Segments, PathPoints, Stats
continuous_path_from_boundary = ContinuousPathFromBoundary(Curve=curve, LineSpacing=2, BoundaryOffset=0, Angle=0, RandomBridges=True, BridgeDensity=0.3)  # -> Path, Segments, PathPoints, Stats
bottom_layer_contour = BottomLayerContour(
    Curve=curve,
    LineSpacing=2,
    BoundaryOffset=0,
    RandomBridges=True,
    BridgeDensity=0.3,
    UseArcWelder=False,
    ArcTolerance=0.1,
    MinArcRadius=0.1)  # -> Path, Segments, PathPoints, Stats
continuous_toolpath_2 = ContinuousToolpath(
    Curve=curve,
    LineSpacing=2,
    BoundaryOffset=0,
    RandomBridges=True,
    BridgeDensity=0.3,
    HandleUndercuts=True,
    UseArcWelder=False,
    ArcTolerance=0.1)  # -> Path, Segments, PathPoints, Stats
bridge_curves = BridgeCurves(Curves=curve, BridgeDensity=0.3, BridgeLength=10, Random=True, Seed=42)  # -> Path, Bridges, OriginalCurves, Info
bottom_layer_grid = BottomLayerGrid(Curve=curve, LineSpacing=2, BoundaryOffset=0, SpacingY=2, Angle=0, StartLeft=True)  # -> Path, Segments, PathPoints, Stats
bottom_layer_hilbert = BottomLayerHilbert(Curve=curve, LineSpacing=2, BoundaryOffset=0, Order=4)  # -> Path, Segments, PathPoints, Stats
eulerian_path = EulerianPath(
    Boundary=curve,
    PatternType=0,
    LineSpacing=2,
    Angle=0,
    Tolerance=0.01,
    AddBridges=False,
    FixOverlaps=True,
    OverlapOffset=0.1)  # -> Path, PatternSegments, Bridges, Duplicates, Info
number_slider_5 = Slider(2, range=0..10)
curve_3 = Curve([<curve referenced from the Rhino model> x7])
suppress_self_intersections = SuppressSelfIntersections(Curve=eulerian_path.Path, Tolerance=0.01, SplitSegments=False)  # -> HealedCurves, Intersections, Info
bridge_curves_2 = BridgeCurves(Curves=curve_3, BridgeDensity=0.3, BridgeLength=10, Random=True, Seed=42)  # -> Path, Bridges, OriginalCurves, Info
align_curves = AlignCurves(Curves=curve_3, ReferenceIndex=0, Reverse=False)  # -> AlignedCurves, Flipped, Info
alternate_curves = AlternateCurves(Curves=curve_3, StartLeft=False, GroupSize=1)  # -> AlternatedCurves, Flipped, Info
join_open_contours = JoinOpenContours(Contours=alternate_curves.AlternatedCurves, Tolerance=0.01, OptimizeOrder=True, TransitionType=0)  # -> Path, Contours, Transitions, Info
bottom_layer_lines = BottomLayerLines(Curve=curve, LineSpacing=2, BoundaryOffset=number_slider_5, Angle=0, OptimizeOrder=True)  # -> Path, Segments, PathPoints, Stats
bottom_layer_spiral = BottomLayerSpiral(Curve=curve, LineSpacing=2, BoundaryOffset=number_slider_5, Clockwise=True, MinRadius=0)  # -> Path, Segments, PathPoints, Stats
panel = Panel(bridge_curves_2.Info)
curve_4 = Curve(bottom_layer_spiral.Path)
