# Grasshopper definition ZündHGPL PLT MSA.gh (Grasshopper 1.0.8)
# plug-ins: LARGERslicer

links_starten = BooleanToggle(False)
abtastschritte = Slider(1, range=0..10)
rasterpitch = Slider(0.6, range=0..1)
erweiterung_der_bounding_box = Slider(1, range=0..1)

tool = ValueList({"Fräser": 31}, selected="Fräser")
vacuum = BooleanToggle(False)
underlay = BooleanToggle(False)
vorschub_mm_s = Slider(7, range=0..100)
eilgang_mm_s = Slider(100, range=0..100)
sicherheitsabstand = Slider(0, range=0..10)

plt_schreiben = BooleanToggle(True)
# Sehr gern – hier eine kompakte Dokumentation, die du dir als Panel oder Scribble neben die GhPython-Komponente hängen kannst.
# Sie erklärt Inputs, Outputs, Workflow und Tipps für den Zünd-Export.
# 
# ⸻
# 
# 📄 Dokumentation – Boustrophedon Toolpath Generator (GhPython)
# 
# Funktion:
# Erzeugt einen durchgehenden Werkzeugpfad im „Boustrophedon“-Muster (links ↔ rechts ↔ links …).
# Die XY-Linien laufen gerade durch, die Z-Höhe wird direkt aus der Geometrie gesampelt.
# Optional wird eine Zünd-PLT-Datei mit PU / MF / MW Befehlen erstellt.
# 
# ⸻
# 
# 🔹 Inputs
# 	•	Geo (Mesh/Brep/Surface) → Geometrie, die gefräst werden soll
# 	•	dx (Number) → Abtastschritt in X (mm), z. B. 0.5
# 	•	dy (Number) → Rasterpitch in Y (mm), z. B. 1.5
# 	•	Margin (Number) → Erweiterung der BoundingBox (mm), z. B. 2.0
# 	•	StartLeft (Bool) → True = erste Bahn von links nach rechts, False = umgekehrt
# 	•	MakePLT (Bool) → True = erzeugt Zünd-PLT-Code
# 	•	VW (Number) → Vorschub (cm/s) für Arbeitsbewegungen
# 	•	VF (Number) → Vorschub (cm/s) für Eilgang
# 	•	Zup (Number) → Sicherheits-Z in mm (z. B. 10)
# 	•	Tool (Int) → Werkzeugnummer (z. B. 31 für Fräser)
# 	•	Vacuum (Bool) → Absaugung ein/aus (PB9,1)
# 	•	Underlay (Bool) → Unterlage an/aus (XX308,1)
# 
# ⸻
# 
# 🔹 Outputs
# 	•	Path (Curve) → eine durchgehende PolylineCurve (gesamter Fräspfad)
# 	•	Segments (List) → Einzelsegmente (jede Scanline) zur Kontrolle
# 	•	PLT (String) → kompletter Zünd-PLT-Text (kann direkt gespeichert oder gesendet werden)
# 	•	Stats (String) → Info: Anzahl Segmente, Punkte, Gesamtlänge, aktuelle Parameter
# 
# ⸻
# 
# 🔹 Workflow
# 	1.	Geometrie (Mesh oder Surface/Brep) an Geo anschließen.
# 	2.	dx und dy einstellen (abhängig vom Werkzeugdurchmesser, dy ≈ 40–60 % vom Fräser-Ø).
# 	3.	Mit Path und Segments visuell kontrollieren, ob der Pfad korrekt ist.
# 	4.	Bei MakePLT = True werden Header/Trailer + Bewegungen als PLT-Text ausgegeben.
# 	•	PLT in eine .plt-Datei speichern oder per TCP an die Zünd senden.
# 
# ⸻
# 
# 🔹 Tipps
# 	•	Einheiten: Alles in mm; PLT wird automatisch in 1/100 mm umgerechnet.
# 	•	dx kleiner → glattere Z-Abtastung, aber größere Dateigröße.
# 	•	dy kleiner → dichteres Raster, bessere Oberflächenqualität, aber längere Fräszeit.
# 	•	Margin sorgt dafür, dass der Pfad sicher etwas übersteht.
# 	•	Für Reliefs/Texturen funktioniert das Verfahren gut, für steile Wände ggf. nachbearbeiten.
# 
# ⸻
# 
# 👉 Soll ich dir zusätzlich noch eine kleine Beispiel-Definition (.gh) bauen, wo ein Mesh + Parameter angeschlossen sind, sodass du sofort einen Pfad und PLT bekommst?
header_mode = ValueList({"Simple": SIMPLE, "Extended": EXTENDED}, selected="Simple")
geometry = Geometry(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)
boustrophedon_toolpath = BoustrophedonToolpath(
    Geometry=geometry,
    StepX=abtastschritte,
    StepY=rasterpitch,
    Margin=erweiterung_der_bounding_box,
    StartLeft=links_starten,
    MakePLT=plt_schreiben,
    FeedSpeed=vorschub_mm_s,
    RapidSpeed=eilgang_mm_s,
    ZUp=sicherheitsabstand,
    Tool=tool,
    Vacuum=vacuum,
    Underlay=underlay,
    HeaderMode=header_mode)  # -> Path, Segments, PLT, Stats
